# Grasshopper definition builder.gh (Grasshopper 1.0.8)
# plug-ins: ClipperComponents

crv = Curve(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)
geo = Geometry([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])
geo_2 = Geometry([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])
geo_3 = Geometry(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)
geo_4 = Geometry(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)
road = Python3Script(crvs=crv, width=Slider(4, range=0..10))  # -> road_data; inputs crvs: list of Curve, width: Double
# ---------- road: Python ----------
road_data = []
for crv in crvs:
    road_data.append((crv, width))
# ---------- end road ----------
road_2 = Python3Script(crvs=geo_3, width=Slider(9, range=0..10))  # -> road_data; inputs crvs: list of Curve, width: Double; same code as road
road_3 = Python3Script(crvs=geo, width=Slider(5, range=0..10))  # -> road_data; inputs crvs: list of Curve, width: Double; same code as road
road_4 = Python3Script(crvs=geo_4, width=Slider(10, range=0..10))  # -> road_data; inputs crvs: list of Curve, width: Double; same code as road
road_5 = Python3Script(crvs=geo_2, width=Slider(6, range=0..10))  # -> road_data; inputs crvs: list of Curve, width: Double; same code as road
geo_5 = Geometry(<curve referenced from the Rhino model>)
merge_road_data = Python3Script(road_data_list=[road, road_3, road_5, road_2, road_4])  # -> result; inputs road_data_list: list
# ---------- merge_road_data: Python ----------
result = []
for road_data in road_data_list:
    result.append(road_data)
# ---------- end merge_road_data ----------
geo_6 = Geometry(<curve referenced from the Rhino model>)
geo_7 = Geometry([<point referenced from the Rhino model> x3])
py3 = Python3Script()  # -> out, a, b, c, d
# ---------- py3: Python ----------
import scriptcontext as sc

a,b,c,d= sc.sticky["Junction"]


print (a)
print (b)
print ()
# ---------- end py3 ----------
py3_2 = Python3Script(script=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, road_data=merge_road_data)  # -> out, edges, nodes, roads, junctions; inputs road_data: list; unedited script template
py3_3 = Python3Script(x=geo_6, y=geo_7)  # -> out, a; inputs x: Curve, y: list of Point3d
# ---------- py3_3: Python ----------
import utils

a = utils.split_curve_at_pts(x,y)

print(len(a))
# ---------- end py3_3 ----------
geo_8 = Geometry(py3.d)
geo_9 = Geometry(py3.c)
geo_10 = Geometry(py3.a)
geo_11 = Geometry(py3.b)
mcx = MultipleCurves(Curves=geo_11)  # -> Points, IndexA, IndexB, ParamA, ParamB
boundary = BoundarySurfaces(Edges=py3_2.junctions)
geo_12 = Geometry(py3_2.edges)
item = ListItem(List=geo_12, Index=Slider(10, range=0..18), Wrap=True)
polyoffset = PolylineOffset(
    Polylines=item,
    Distance=Slider(4, range=2..6),
    Plane=Plane(origin=(0, 0, 0), x=(0, 0, 0), y=(0, 0, 0)),
    Tolerance=0.001,
    ClosedFillet=1,
    OpenFillet=1,
    Miter=2)  # -> Contour, Holes
geo_13 = Geometry(py3_2.roads)
panel = Panel(py3_2.out)
